# Requirement set requirements (R2022a)

## 1 [#1] Stage1

### 1.1 [#6] row17
Stage 1 avionics subsystem shall feature a mandatory operational Eggtimer TRS Flight Computer for official altitude logging and GPS tracking.

### 1.2 [#7] row19
Stage 1 avionics subsystem shall transmit tracking telemetry beacon each X seconds.

### 1.3 [#8] row21
Stage 1 avionics subsystem transmit tracking telemetry beacon shall follow the predefined telemetry message structure (TBD)

### 1.4 [#17] row25
Stage 1 avionics subsystem shall deploy drogue parachute at TBD s

### 1.5 [#18] row26
Stage 1 avionics subsystem shall deploy main parachute at TBD s

### 1.6 [#19] row29
Stage 1 avionics subsystem shall not weight more than TBD g

### 1.7 [#20] row30
Stage 1 avionics subsystem shall not weight more than TBD g

### 1.8 [#21] row32
Stage 1 avionics subsystem shall be able to transmit it's telemetry beacons with a maximum error rate of TBD under a nominal velocity of TBD m/s.

### 1.9 [#22] row34
Stage 1 avionics subsystem installed in proximity of the piston's black powder mechanism shall widthstand the heat generated when activated.

## 2 [#2] Stage2

### 2.1 [#10] row18
Stage 2 avionics subsystem shall feature a mandatory operational Eggtimer TRS Flight Computer for official altitude logging and GPS tracking.

### 2.2 [#11] row20
Stage 2 avionics subsystem shall transmit tracking telemetry beacon each X seconds.

### 2.3 [#12] row22
Stage 2 avionics subsystem transmit tracking telemetry beacon shall follow the predefined telemetry message structure (TBD)

### 2.4 [#23] row23
Stage 2 avionics subsystem shall ignite the 2nd stage solid motor either under a time condition (elapsed seconds since launch) or a flag condition (TBD)

### 2.5 [#24] row24
Stage 2 avionics subsystem shall deploy the payloads at TBD s

### 2.6 [#25] row27
Stage 2 avionics subsystem shall deploy drogue parachute at TBD s

### 2.7 [#26] row28
Stage 2 avionics subsystem shall deploy main parachute at TBD s

### 2.8 [#27] row31
Stage 2 avionics subsystem shall automatically check that it's attitude is upwards and within TBD degrees of deviation from Earth's normal vector before igniting its propulsion.

### 2.9 [#28] row33
Stage 2 avionics subsystem shall be able to transmit it's telemetry beacons with a maximum error rate of TBD under a nominal velocity of TBD m/s.

## 3 [#3] Hardware-ALL

### 3.1 [#14] row2
All avionics subsystems shall implement redundant recovery system electronics, including sensors/flight computers and "electric initiators".

### 3.2 [#15] row3
Redundant avionics systems shall have independent power supply.

### 3.3 [#16] row4
All avionics subsystems onboard batteries should be in accessible positions if cannot be externally charged.

### 3.4 [#29] row5
All avionics subsystems onboard batteries shall have at least six hours of battery life on the launch rail.

### 3.5 [#30] row6
All avionics subsystems onboard batteries should be capable of being charged using a feedthrough connector in the avionics hatch.

### 3.6 [#31] row7
All onboard batteries should feature the same nominal voltage.

### 3.7 [#32] row8
At least one redundant recovery system electronics subsystem shall implement a COTS flight computer

### 3.8 [#33] row9
The interconnection redundancy of the nominal and redundant recovery electronics and recovery systems should be implemented as illustrated in Figure 2 (DT&EG, pg 18).

### 3.9 [#34] row10
All avionics subsystem switches and connectors should be accessible from an avionics hatch (access panel) on the airframe.

### 3.10 [#35] row11
All of the TRS Flight Computers should be purchased with the capability to operate within the US "Ham" frequency range.

### 3.11 [#36] row12
Team shall be capable of (and prepared to) re-program their operating frequencies of Eggtimer/finder equipment at short notice in case launch schedule reshuffling requires it so.

### 3.12 [#37] row13
Team shall ensure that TRS Flight Computer is running a custom version of the firmware for the 70 cm Ham frequency band, having a channel selection resolution of 25 kHz.

### 3.13 [#38] row14
Team shall procure the Eggfinder TRS Flight Computer "full kit package", as it includes the LCD GPS receiver.

### 3.14 [#39] row15
All safety critical wiring shall implement a cable management solution (e.g., wire ties, wiring, harnesses, cable raceways) which will prevent tangling and excessive free movement of significant wiring/cable lengths due to expected launch loads.

### 3.15 [#40] row16
All safety critical wiring/cable connections shall be sufficiently secure as to prevent de-mating due to expected launch loads. This will be verified by a tug test, by hand.